% Requirement links of KeylessEntryArchitecture.slx (R2020a)

block :3 implements FunctionalRequirements.slreqx#1: Should unlock door
block :3 implements FunctionalRequirements.slreqx#2: Should lock door
block :51 implements FunctionalRequirements.slreqx#6: Emit sound when car unlocked
block :51 implements FunctionalRequirements.slreqx#7: Emit sound when car locked
block :51 implements FunctionalRequirements.slreqx#8: Emit sound when car is on but not key detected
block :60 implements FunctionalRequirements.slreqx#9: Engine start with push button
block :60 implements FunctionalRequirements.slreqx#10: Engine stop with push button
block :71 implements FunctionalRequirements.slreqx#5: Flash headlights on lock
block :71 implements FunctionalRequirements.slreqx#4: Automatically turn off headlights
block :72 implements FunctionalRequirements.slreqx#3: Welcome lights
block :73 implements FunctionalRequirements.slreqx#3: Welcome lights
block :73 implements FunctionalRequirements.slreqx#4: Automatically turn off headlights
block :73 implements FunctionalRequirements.slreqx#5: Flash headlights on lock